# Grasshopper definition Parabolic Paraboloid.gh (Grasshopper 1.0.7)

height_4 = GetInteger(Slider(0, range=0..10), AtLeast=1, AtMost=1, Maximum=2147483647, Minimum=-2147483648, TreeAccess=False)
rotation_4 = GetInteger(Slider(0, range=0..10), AtLeast=1, AtMost=1, Maximum=2147483647, Minimum=-2147483648, TreeAccess=False)
angular_distance_4 = GetInteger(
    Slider(10, range=0..10),
    AtLeast=1,
    AtMost=1,
    Maximum=2147483647,
    Minimum=-2147483648,
    Prompt="Angle 4",
    TreeAccess=False)
construct_point = ConstructPoint(XCoordinate=angular_distance_4, YCoordinate=rotation_4, ZCoordinate=height_4)

height_3 = GetInteger(Slider(18, range=0..30), AtLeast=1, AtMost=1, Maximum=2147483647, Minimum=-2147483648, TreeAccess=False)
rotation_3 = GetInteger(Slider(10, range=0..30), AtLeast=1, AtMost=1, Maximum=2147483647, Minimum=-2147483648, TreeAccess=False)
angular_distance_3 = GetInteger(Slider(10, range=0..30), AtLeast=1, AtMost=1, Maximum=2147483647, Minimum=-2147483648, TreeAccess=False)
construct_point_2 = ConstructPoint(XCoordinate=angular_distance_3, YCoordinate=rotation_3, ZCoordinate=height_3)

rotation_2 = GetInteger(Slider(10, range=0..10), AtLeast=1, AtMost=1, Maximum=2147483647, Minimum=-2147483648, TreeAccess=False)
height_2 = GetInteger(Slider(0, range=0..10), AtLeast=1, AtMost=1, Maximum=2147483647, Minimum=-2147483648, TreeAccess=False)
angular_distance_2 = GetInteger(Slider(0, range=0..10), AtLeast=1, AtMost=1, Maximum=2147483647, Minimum=-2147483648, TreeAccess=False)
construct_point_3 = ConstructPoint(XCoordinate=angular_distance_2, YCoordinate=rotation_2, ZCoordinate=height_2)

rotation_1 = GetInteger(Slider(0, range=0..10), AtLeast=1, AtMost=1, Maximum=2147483647, Minimum=-2147483648, TreeAccess=False)
height_1 = GetInteger(Slider(10, range=0..10), AtLeast=1, AtMost=1, Maximum=2147483647, Minimum=-2147483648, TreeAccess=False)
angular_distance_1 = GetInteger(Slider(0, range=0..10), AtLeast=1, AtMost=1, Maximum=2147483647, Minimum=-2147483648, TreeAccess=False)
construct_point_4 = ConstructPoint(XCoordinate=angular_distance_1, YCoordinate=rotation_1, ZCoordinate=height_1)

point = Point(construct_point_3)
point_2 = Point(construct_point_4)
point_3 = Point(construct_point)
point_4 = Point(construct_point_2)
_4point_surface = _4PointSurface(CornerA=point_2, CornerB=point, CornerC=point_4, CornerD=point_3)
line = Line(StartPoint=point, EndPoint=point_2)
line_2 = Line(StartPoint=point_4, EndPoint=point_3)
surface = Surface(_4point_surface)
length = Length(Curve=line_2)

grid_size = Slider(0.6, range=0..0.6)
grid_size_2 = GetInteger(grid_size, AtLeast=1, AtMost=1, Maximum=2147483647, Minimum=-2147483648, TreeAccess=False)
division = Division(A=length, B=grid_size_2)

length_2 = Length(Curve=line)

grid_size_3 = Slider(0.6, range=0..0.6)
grid = GetInteger(grid_size_3, AtLeast=1, AtMost=1, Maximum=2147483647, Minimum=-2147483648, TreeAccess=False)
division_2 = Division(A=length_2, B=grid)

round = Round(Number=division)  # -> Nearest, Floor, Ceiling
round_2 = Round(Number=division_2)  # -> Nearest, Floor, Ceiling
divide_curve = DivideCurve(Curve=line_2, Count=round.Ceiling, Kinks=False)  # -> Points, Tangents, Parameters
divide_curve_2 = DivideCurve(Curve=line, Count=round_2.Ceiling, Kinks=False)  # -> Points, Tangents, Parameters

height = GetInteger(Slider(0, range=0..1), AtLeast=1, AtMost=1, Maximum=2147483647, Minimum=-2147483648, TreeAccess=False)
negative = Negative(Value=height)

line_3 = Line(StartPoint=divide_curve_2.Points, EndPoint=divide_curve.Points)
panel = Panel(line_3)
list_item = ListItem(List=line_3, Index=0, Wrap=True)  # -> Item1, Item
xz_plane = XZPlane(Origin=Point(0, 0, 0))
offset_curve = OffsetCurve(Curve=list_item.Item, Distance=negative, Plane=xz_plane, Corners=1)
offset_curve_2 = OffsetCurve(Curve=list_item.Item1, Distance=negative, Plane=xz_plane, Corners=1)
length_3 = Length(Curve=offset_curve_2)
length_4 = Length(Curve=offset_curve)
division_3 = Division(A=length_3, B=grid_size_3)
division_4 = Division(A=length_4, B=grid_size_3)
round_3 = Round(Number=division_3)  # -> Nearest, Floor, Ceiling
round_4 = Round(Number=division_4)  # -> Nearest, Floor, Ceiling
divide_curve_3 = DivideCurve(Curve=offset_curve_2, Count=round_3.Floor, Kinks=False)  # -> Points, Tangents, Parameters
divide_curve_4 = DivideCurve(Curve=offset_curve, Count=round_4.Floor, Kinks=False)  # -> Points, Tangents, Parameters
line_4 = Line(StartPoint=divide_curve_3.Points, EndPoint=divide_curve_4.Points)
rotate = Rotate(Geometry=line_3, Angle=1.570796327, Plane=PlaneXY(0, 0, 0))  # -> Geometry, Transform
rotate_2 = Rotate(Geometry=line_4, Angle=1.570796327, Plane=PlaneXY(0, 0, 0))  # -> Geometry, Transform
rotate_3 = Rotate(Geometry=rotate_2.Geometry, Angle=1.570796327, Plane=PlaneXY(0, 0, 0))  # -> Geometry, Transform
rotate_4 = Rotate(Geometry=rotate.Geometry, Angle=1.570796327, Plane=PlaneXY(0, 0, 0))  # -> Geometry, Transform
rotate_5 = Rotate(Geometry=rotate_3.Geometry, Angle=1.570796327, Plane=PlaneXY(0, 0, 0))  # -> Geometry, Transform
rotate_6 = Rotate(Geometry=rotate_4.Geometry, Angle=1.570796327, Plane=PlaneXY(0, 0, 0))  # -> Geometry, Transform
pipe = Pipe(Curve=rotate_2.Geometry, Radius="0.04", Caps=0)
pipe_2 = Pipe(Curve=rotate_3.Geometry, Radius="0.04", Caps=0)
pipe_3 = Pipe(Curve=line_3, Radius="0.04", Caps=0)
pipe_4 = Pipe(Curve=line_4, Radius="0.04", Caps=0)
pipe_5 = Pipe(Curve=rotate.Geometry, Radius="0.04", Caps=0)
pipe_6 = Pipe(Curve=rotate_6.Geometry, Radius="0.04", Caps=0)
pipe_7 = Pipe(Curve=rotate_4.Geometry, Radius="0.04", Caps=0)
pipe_8 = Pipe(Curve=rotate_5.Geometry, Radius="0.04", Caps=0)
geo = Geometry([pipe, pipe_4, pipe_2, pipe_8, pipe_6, pipe_7, pipe_5])
parabola = GetGeometry(geo, AtLeast=1, AtMost=1, DeleteInput=False, Filter=1074004029, TreeAccess=False)

# ---- group: RH_OUT:Parabola
brep = Brep(parabola)

# ----
context_bake = ContextBake(Geometry=brep)
